# Grasshopper definition DataGeneration.gh (Grasshopper 0.9.76)
# plug-ins: Owl.GH

range = Range(Domain=Domain(0, 1), Steps="9")
graph = GraphMapper(range, x0=0, x1=1, y0=0, y1=0.5, container_name="Sine", Equation_px=[0, 1], Equation_py=[0, 1])
graph_2 = GraphMapper(range, x0=0, x1=1, y0=0, y1=0.5, container_name="Sine", Equation_px=[0, 0.4131079316], Equation_py=[0, 0.954310894])
pt = ConstructPoint(XCoordinate=0, YCoordinate=range, ZCoordinate=graph)
pt_2 = ConstructPoint(XCoordinate=range, YCoordinate=0, ZCoordinate=graph_2)
nurbs = NurbsCurve(Vertices=pt_2, Degree=3, Periodic=False)  # -> Curve, Length, Domain
nurbs_2 = NurbsCurve(Vertices=pt, Degree=3, Periodic=False)  # -> Curve, Length, Domain
sumsrf = SumSurface(CurveA=nurbs.Curve, CurveB=nurbs_2.Curve)
popgeo = PopulateGeometry(Geometry=sumsrf, Count=100, Seed=1)

range_2 = Range(Domain=Domain(0, 1), Steps=Slider(100, range=0..1000))
crossref = CrossReference(ListA=range_2, ListB=range_2, CrossMode=1)  # -> ListA, ListB
pt_3 = ConstructPoint(XCoordinate=crossref.ListA, YCoordinate=crossref.ListB, ZCoordinate=0)
pdecon = Deconstruct(Point=pt_3)  # -> XComponent, YComponent, ZComponent
featurets = FeatureTensorSet(Feature0=pdecon.XComponent, Feature1=pdecon.YComponent)
toidx = SaveIDXTensorSet(TensorSet=featurets, SaveFile="C:/Users/Mateusz/Desktop/Random100_Query.idx", DataType="System.Single")

loadtset = LoadTensorSet(LoadFile="C:/Users/Mateusz/Desktop/TrainingResults.idx", Position=0, Count=-1)
detset = DeconstructTensorSet(TensorSet=loadtset)
detensor = DeconstructTensor(Tensor=detset)  # -> flatten(Values)
pt_4 = ConstructPoint(XCoordinate=pdecon.XComponent, YCoordinate=pdecon.YComponent, ZCoordinate=detensor)

pdecon_2 = Deconstruct(Point=popgeo)  # -> XComponent, YComponent, ZComponent
featurets_2 = FeatureTensorSet(Feature0=pdecon_2.ZComponent)
featurets_3 = FeatureTensorSet(Feature0=pdecon_2.XComponent, Feature1=pdecon_2.YComponent)
toidx_2 = SaveIDXTensorSet(TensorSet=featurets_3, SaveFile="C:/Users/Mateusz/Desktop/Random100_Inputs.idx", DataType="System.Single")
toidx_3 = SaveIDXTensorSet(TensorSet=featurets_2, SaveFile="C:/Users/Mateusz/Desktop/Random100_Outputs.idx", DataType="System.Single")
